vi "index.gviweb"   [G Web Development Software 22.0.0]
panel controls:
  "stop": bool
  "Fd": f64 = 5
  "Fc": f64 = 5
  "forstyrrelse Fd": bool
  "Pause": bool
  "P-REGULATOR": bool
  "SKAL-verdi": f64 = 50
  "Kp": f64 = 0.5
panel indicators:
  "Trendkurver for nivå": cluster{"Element 1": f64, "Element 2": f64}
  "Tank": f64
  "Fut": f64
  "Trendkurver for prosesstrømmer": T1
  "Er verdi": f64
  "F_c": f64
  "F_d": f64
types:
  T1 = cluster{"Element 1": f64, "Element 2": f64, "Element 3": f64}
diagram:
  s1 = 50  # shift register
  s2 = 0  # shift register
  while {
    Build Cluster(s1, $"SKAL-verdi") -> w1
    $"Trendkurver for nivå" <- w1
    $Tank <- s1
    $F_d <- $Fd
    In Range And Coerce(lower limit=0, upper limit=10, x=$Fc) -> (coerced(x)=w2)
    $F_c <- w2
    Build Cluster($Fd, w2, $Fut) -> w3
    $"Trendkurver for prosesstrømmer" <- w3
    Add($Fd, $Fc) -> w4
    Subtract(x=w4, y=$Fut) -> w5
    Add(w5, s1) -> w6
    In Range And Coerce(lower limit=0, upper limit=100, x=w6) -> (coerced(x)=w7)
    $"Er verdi" <- w7
    Square Root(x=s1) -> w8
    Square Root(x=2) -> w9
    Multiply(w8, w9) -> w10
    $Fut <- w10
    case ($"forstyrrelse Fd") {
      frame False, Default {
        w11 = 0
      }
      frame True {
        Increment(x=s2) -> w12
        Is Greater(x=w12, y=20) -> w13
        Select(s=w13, t=0, f=w12) -> w11
        Is Less(x=s2, y=1) -> w14
        case (w14) {
          frame False, Default { }
          frame True {
            Random Number() -> (number (0 to 1)=w15)
            Multiply(w15, 10) -> w16
            $Fd <- w16
          }
        }
      }
    }
    case ($Pause) {
      frame False, Default { }
      frame True {
        while {
          Not(x=$Pause) -> w17
          stop if w17
        }
      }
    }
    case ($"P-REGULATOR") {
      frame False, Default { }
      frame True {
        Subtract(x=$"SKAL-verdi", y=$"Er verdi") -> w18
        Multiply(w18, $Kp) -> w19
        $Fc <- w19
      }
    }
    Wait(time to wait=250)
    next s1 = w7
    next s2 = w11
    stop if $stop
  }
